# Grasshopper definition parabola_project.gh (Grasshopper 1.0.7)

number_slider = Slider(3.081, range=0..10)
neg = Negative(Value=Slider(1.69, range=0..10))
neg_2 = Negative(Value=number_slider)
bnd = Bounds(Numbers=[number_slider, neg_2])
range = Range(Domain=bnd, Steps=10)
sqr = Square(Value=range)
neg_3 = Negative(Value=sqr)
pt = ConstructPoint(XCoordinate=range, YCoordinate=0, ZCoordinate=neg_3)
intcrv = Interpolate(Vertices=pt, Degree=3, Periodic=False, KnotStyle=1)  # -> Curve, Length, Domain
