# Grasshopper definition solar_path_main.gh (Grasshopper 1.0.7)

minutes = Slider(11, range=0..60)
degrees = Slider(51, range=0..89)
C = Count(13)
division = Division(A=minutes, B=60)
series = Series(Start=-90, Step=15, Count=C)
addition = Addition(A=degrees, B=division)
list = ValueList({"Equinox": 0, "Summer Solstice": 23.45, "Winter Solstice": -23.45}, selected="Equinox")
number_slider = Slider(64, range=0..100)
rad = Radians(Degrees=series)
rad_2 = Radians(Degrees=addition)
P = Plane(PlaneXY(0, 0, 0))
rad_3 = Radians(Degrees=list)
cir = Circle(Plane=P, Radius=number_slider)
c_script = CSharpScript(r=number_slider, HRA=rad, LAT=rad_2, DEC=rad_3)  # -> out, rs, ds, ALT_values; inputs r: Double, HRA: Double, LAT: Double, DEC: Double
# ---------- c_script: C# ----------
    /*Convert to degrees*/
    double cdg = (180 / Math.PI);

    double ALT = (Math.Asin((Math.Sin(DEC) * Math.Sin(LAT)) + (Math.Cos(DEC) * Math.Cos(LAT) * Math.Cos(HRA))));

    List<double> ALT_list = new List<double>();
    ALT_list.Add(ALT);

    List<double> ALT_list_corrected = new List<double>();

    foreach (double i in ALT_list){
      ALT_list_corrected.Add(i * 1);

    }

/*
    foreach (int i in ALT_list){
      if (i < 6) {
        Console.WriteLine(ALT_list_corrected[i]);
      }}
 */

    rs = r * Math.Cos(DEC) / (Math.Sin(ALT) + Math.Sin(DEC));
    ds = r * ((Math.Cos(LAT)) * cdg) / (Math.Sin(LAT)*cdg + Math.Sin(DEC)*cdg);
    ALT_values = ALT_list_corrected[0];
# ---------- end c_script ----------
division_2 = Division(A=number_slider, B=C)
series_2 = Series(Start=0, Step=division_2, Count=C)
deg = Degrees(Radians=c_script.ALT_values)
subtraction = Subtraction(A=c_script.rs, B=c_script.ds)
split = SplitList(List=deg, Index=6)  # -> ListA, ListB
arc = Arc(Plane=PlaneXY(0, 0, 0), Radius=c_script.ds, Angle=Domain(0, 3.141592654))  # -> Arc, Length
neg = Negative(Value=split.ListA)
pt = ConstructPoint(XCoordinate=series_2, YCoordinate=subtraction, ZCoordinate=0)
cset = CreateSet(List=[neg, split.ListB])  # -> Set, Map
darc = DeconstructArc(Arc=arc.Arc)  # -> BasePlane, Radius, Angle
neg_2 = Negative(Value=darc.Radius)
Y = UnitY(Factor=neg_2)
panel = Panel(cset.Set)
move = Move(Geometry=arc.Arc, Motion=Y)  # -> Geometry, Transform
